# Dynamo graph hideRevClouds.dyn (Dynamo 2.6.1.8786)
# packages: archi-lab.net 2021.25.2721, Genius Loci 2021.6.3

categories = Categories("OST_RevisionClouds")
all_elements_of_category = ElementsOfCategory(Category=categories)
revision = RevisionCloud.Revision(revisionCloud=all_elements_of_category)
revision_properties = Custom[Revision Properties](revision=revision)  # package archi-lab.net; This node will return some most common Revision properties like Description or Issue Date.
select_revision = RevitRevisions("Seq. 8 - Revision 8")
revision_properties_2 = Custom[Revision Properties](revision=select_revision)
eq = revision_properties.description == revision_properties_2.description  # lacing=Longest
filterByBoolMask = List.FilterByBoolMask(list=all_elements_of_category, mask=eq)
ownerView = archilab.Revit.Elements.Elements.OwnerView(element=filterByBoolMask.in)
boolean = BoolSelector(false)
view_setelementoverrides = Custom[View SetElementOverrides](view=ownerView, elements=filterByBoolMask.in, hide=boolean)  # package Genius Loci; Overrides element graphics settings in the given view. For use with the Create OverrideGraphicSettings node. Can also be used to hide or unhide elements.
